# Grasshopper definition test4.ghx (Grasshopper 1.0.7)

breedte = Slider(2500, range=1000..6500)
lengte = Slider(4000, range=4000..26000)
toog = Slider(200, range=100..1000)
division = Division(A=breedte, B="2")
neg = Negative(Value=breedte)
division_2 = Division(A=neg, B="2")
subtraction = Subtraction(A="0", B="25")
subtraction_2 = Subtraction(A="0", B="25")
division_3 = Division(A=lengte, B="2")
division_4 = Division(A=lengte, B="50")
division_5 = Division(A=lengte, B="2")
division_6 = Division(A=lengte, B="50")
addition = Addition(A=subtraction, B=toog)
addition_2 = Addition(A="25", B=division_4)
addition_3 = Addition(A=subtraction_2, B=toog)
addition_4 = Addition(A="25", B=division_6)
subtraction_3 = Subtraction(A=toog, B=addition_2)
subtraction_4 = Subtraction(A=division, B=division_4)
pt = ConstructPoint(XCoordinate="0", YCoordinate=division, ZCoordinate="0")
pt_2 = ConstructPoint(XCoordinate=division_3, YCoordinate=division, ZCoordinate=addition)
pt_3 = ConstructPoint(XCoordinate=lengte, YCoordinate=division, ZCoordinate="0")
subtraction_5 = Subtraction(A=toog, B=addition_4)
subtraction_6 = Subtraction(A=division_2, B=division_6)
addition_5 = Addition(A=division_2, B=division_6)
pt_4 = ConstructPoint(XCoordinate="0", YCoordinate=division_2, ZCoordinate="0")
pt_5 = ConstructPoint(XCoordinate=division_5, YCoordinate=division_2, ZCoordinate=addition_3)
pt_6 = ConstructPoint(XCoordinate=lengte, YCoordinate=division_2, ZCoordinate="0")
neg_2 = Negative(Value=addition_2)
neg_3 = Negative(Value=addition_4)
arc = Arc3Pt(PointA=pt, PointB=pt_2, PointC=pt_3)  # -> Arc, Plane, Radius
arc_2 = Arc3Pt(PointA=pt_4, PointB=pt_5, PointC=pt_6)  # -> Arc, Plane, Radius
pt_7 = ConstructPoint(XCoordinate="0", YCoordinate=subtraction_4, ZCoordinate=neg_2)
pt_8 = ConstructPoint(XCoordinate=division_3, YCoordinate=subtraction_4, ZCoordinate=subtraction_3)
pt_9 = ConstructPoint(XCoordinate=lengte, YCoordinate=subtraction_4, ZCoordinate=neg_2)
pt_10 = ConstructPoint(XCoordinate="0", YCoordinate=addition_5, ZCoordinate=neg_3)
pt_11 = ConstructPoint(XCoordinate=division_5, YCoordinate=addition_5, ZCoordinate=subtraction_5)
pt_12 = ConstructPoint(XCoordinate=lengte, YCoordinate=addition_5, ZCoordinate=neg_3)
arc_3 = Arc3Pt(PointA=pt_7, PointB=pt_8, PointC=pt_9)  # -> Arc, Plane, Radius
arc_4 = Arc3Pt(PointA=pt_10, PointB=pt_11, PointC=pt_12)  # -> Arc, Plane, Radius
rulesrf = RuledSurface(CurveA=arc.Arc, CurveB=arc_3.Arc)
rulesrf_2 = RuledSurface(CurveA=arc_2.Arc, CurveB=arc_4.Arc)
rulesrf_3 = RuledSurface(CurveA=arc_3.Arc, CurveB=arc_4.Arc)
